# Grasshopper definition test_minimal.gh (Grasshopper 1.0.8)

curves = Curve([<curve referenced from the Rhino model> x320])
graft_tree = GraftTree(Tree=curves, IncludeEmptyLists=True, IncludeNullItems=True)
pipe = Pipe(Curve=graft_tree, Radius=Slider(0.5, range=0..1), Caps=2, FitRail=False)
mesh_brep = MeshBrep(
    Brep=pipe,
    Settings={GridMaxCount=0, GridMinCount=16, JaggedSeams=False, MaxEdgeLength=0, MinEdgeLength=0.0001, MinTolerance=0, Refine=True, RefineAngle=0, RelativeTolerance=0.65, SimplePlanes=True, Tolerance=0})
mesh = Geometry(flatten(mesh_brep))
